# Grasshopper definition demo_file.ghx (Grasshopper 0.9.76)
# plug-ins: MeshEdit Components, Python Interpreter, HDTReference, Flux

attr = PythonScript(name="name", value="wall")  # -> out, a
# ---------- attr: Python ----------
a = [{name: value}]
# ---------- end attr ----------
attr_2 = PythonScript(name="name", value="concourse")  # -> out, a; same code as attr
profile = PythonScript(attr=flatten(attr.a))  # -> out, a; inputs attr: list
# ---------- profile: Python ----------
profile = {
}

for attribute in attr:
    for key in attribute.keys():
        profile[key] = attribute[key]

print profile
a = [profile]
# ---------- end profile ----------
profile_2 = PythonScript(attr=flatten(attr_2.a))  # -> out, a; inputs attr: list; same code as profile
boundary = Geometry(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)
barriers = Geometry([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])
barrier = PythonScript(boundary=flatten(barriers), profile=flatten(profile.a))  # -> out, a; inputs boundary: list, profile: list
# ---------- barrier: Python ----------
import rhinoscriptsyntax as rs
import Rhino as rc
    
if len(profile) != 0 and boundary != None:
    
    entities = []
    boundary.reverse()
    profile.reverse()
    
    for curve in boundary:
        
        crv = rs.coercecurve(curve)

        if crv.IsClosed:
            
            entity = {
                'geometry':crv,
                'type':'barrier',
                'profile':profile[-1]
            }
            if len(profile) > 1: profile.pop()
            entities.append(entity)
        
        else: print 'curve not closed... ignoring'
    
    a = entities
# ---------- end barrier ----------
floor = PythonScript(boundary=flatten(boundary), profile=flatten(profile_2.a))  # -> out, a; inputs boundary: list, profile: list
# ---------- floor: Python ----------
import rhinoscriptsyntax as rs
    
if len(profile) != 0 and boundary != None:
    
    entities = []
    boundary.reverse()
    profile.reverse()
    
    for curve in boundary:
        
        
        crv = rs.coercecurve(curve)

        if crv.IsClosed:
        
            entity = {
                'geometry':rs.coercecurve(curve),
                'type':'floor',
                'profile':profile[-1]
            }
            if len(profile) > 1: profile.pop()
            entities.append(entity)
        
        else: print 'curve not closed... ignoring'
    
    a = entities
# ---------- end floor ----------

attr_3 = PythonScript(name="capacity", value="2")  # -> out, a; same code as attr
attr_4 = PythonScript(name="name", value="bathroom")  # -> out, a; same code as attr
profile_3 = PythonScript(attr=flatten([attr_4.a, attr_3.a]))  # -> out, a; inputs attr: list; same code as profile
pt = Point([Point(-7.5, 62.6, 0), Point(35.9, 62.8, 0)])
node = PythonScript(position=flatten(pt), profile=flatten(profile_3.a))  # -> out, a; inputs position: list, profile: list
# ---------- node: Python ----------
import copy
import rhinoscriptsyntax as rs

if len(profile) != 0 and position!= None:
    
    entities = []
    position.reverse()
    profile.reverse()
    
    for p in position:
        entity = {
            'position':rs.coerce3dpoint(p),
            'type': 'node',
            'profile':profile[-1]
        }
        if len(profile) > 1: attr.pop()
        entities.append(entity)

    a = entities
# ---------- end node ----------

attr_5 = PythonScript(name="capacity", value="2")  # -> out, a; same code as attr

attr_6 = PythonScript(name="name", value="gate")  # -> out, a; same code as attr
attr_7 = PythonScript(name="name", value="curbside")  # -> out, a; same code as attr
attr_8 = PythonScript(name="name", value="security")  # -> out, a; same code as attr
profile_4 = PythonScript(attr=flatten(attr_6.a))  # -> out, a; inputs attr: list; same code as profile
profile_5 = PythonScript(attr=flatten(attr_7.a))  # -> out, a; inputs attr: list; same code as profile
profile_6 = PythonScript(attr=flatten([attr_8.a, attr_5.a]))  # -> out, a; inputs attr: list; same code as profile
pt_2 = Point([Point(4.265214634, 53.54037396, 0), Point(22.98931928, 53.39255208, 0)])
pt_3 = Point(Point(14.87710684, 79.93414297, 0))
pt_4 = Point([Point(2.579222705, 2.45101553, 0), Point(15.42154413, 2.526116825, 0), Point(26.68673837, 2.45101553, 0)])
node_2 = PythonScript(position=flatten(pt_2), profile=flatten(profile_6.a))  # -> out, a; inputs position: list, profile: list; same code as node
node_3 = PythonScript(position=flatten(pt_3), profile=flatten(profile_4.a))  # -> out, a; inputs position: list, profile: list; same code as node
node_4 = PythonScript(position=flatten(pt_4), profile=flatten(profile_5.a))  # -> out, a; inputs position: list, profile: list; same code as node

flux_projects = FluxProjects()
select_from_list = SelectFromList(flux_projects, SelectedItem="adoWqVqvlzlowX3Jl")
data_keys = DataKeys(select_from_list)
dispatch = Dispatch(List=data_keys, DispatchPattern=[True, False])  # -> ListA, ListB
flow_control = FlowControl({"Once", "Constantly"}, selected="Constantly")
flow_control_2 = FlowControl({"Once", "Constantly"}, selected="Constantly")
from_flux = FromFlux(
    Key=dispatch.ListA,
    Mode=flow_control,
    keyId="40cb3cd726665aea6aff065b945d8271",
    mode="Constantly",
    Branch0_Path="{0}",
    Branch0_Item0_null_string=False,
    Branch0_Item0_string="leisure",
    Branch0_Item0_TypeName="Grasshopper.Kernel.Types.GH_String",
    Branch1_Path="{1}",
    Branch1_Item0_null_string=False,
    Branch1_Item0_string="family",
    Branch1_Item0_TypeName="Grasshopper.Kernel.Types.GH_String",
    Branch2_Path="{2}",
    Branch2_Item0_null_string=False,
    Branch2_Item0_string="assisted",
    Branch2_Item0_TypeName="Grasshopper.Kernel.Types.GH_String",
    Branch3_Path="{3}",
    Branch3_Item0_null_string=False,
    Branch3_Item0_string="business+",
    Branch3_Item0_TypeName="Grasshopper.Kernel.Types.GH_String",
    Branch4_Path="{4}",
    Branch4_Item0_null_string=False,
    Branch4_Item0_string="business",
    Branch4_Item0_TypeName="Grasshopper.Kernel.Types.GH_String",
    Branch5_Path="{5}",
    Branch5_Item0_null_string=False,
    Branch5_Item0_string="unique",
    Branch5_Item0_TypeName="Grasshopper.Kernel.Types.GH_String")
from_flux_2 = FromFlux(
    Key=dispatch.ListB,
    Mode=flow_control_2,
    keyId="4012e5098a2acc3bb59e6201ecf9dd56",
    mode="Constantly",
    Branch0_Path="{0}",
    Branch0_Item0_null_string=False,
    Branch0_Item0_string="leisure",
    Branch0_Item0_TypeName="Grasshopper.Kernel.Types.GH_String",
    Branch0_Item1_number=60,
    Branch0_Item1_TypeName="Grasshopper.Kernel.Types.GH_Number",
    Branch0_Item2_number=0,
    Branch0_Item2_TypeName="Grasshopper.Kernel.Types.GH_Number",
    Branch0_Item3_number=0,
    Branch0_Item3_TypeName="Grasshopper.Kernel.Types.GH_Number",
    Branch0_Item4_number=0,
    Branch0_Item4_TypeName="Grasshopper.Kernel.Types.GH_Number",
    Branch0_Item5_number=100,
    Branch0_Item5_TypeName="Grasshopper.Kernel.Types.GH_Number",
    Branch0_Item6_number=60,
    Branch0_Item6_TypeName="Grasshopper.Kernel.Types.GH_Number",
    Branch0_Item7_number=30,
    Branch0_Item7_TypeName="Grasshopper.Kernel.Types.GH_Number",
    Branch0_Item8_number=70,
    Branch0_Item8_TypeName="Grasshopper.Kernel.Types.GH_Number",
    Branch0_Item9_number=40,
    Branch0_Item9_TypeName="Grasshopper.Kernel.Types.GH_Number",
    Branch0_Item10_number=30,
    Branch0_Item10_TypeName="Grasshopper.Kernel.Types.GH_Number",
    Branch0_Item11_number=0,
    Branch0_Item11_TypeName="Grasshopper.Kernel.Types.GH_Number",
    Branch0_Item12_number=30,
    Branch0_Item12_TypeName="Grasshopper.Kernel.Types.GH_Number"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)
python = PythonScript(keys=from_flux, values=from_flux_2)  # -> out, a; inputs keys: list, values: tree
# ---------- python: Python ----------
import clr
clr.AddReference("Grasshopper")
from Grasshopper import DataTree
from Grasshopper.Kernel.Data import GH_Path

profiles = []

for i, branch in enumerate(values.Branches):
    profile = {
        'name': 'passenger',
        'status': {
            'def': branch[0],
            'origin': 'curbside',
            'destination': 'gate'
        },
        'properties': {
        }
    }
    for r in range(len(keys)):
        profile['properties'][keys[r]] = float(branch[r+1])
    
    profiles.append(profile)
    
a = profiles
# ---------- end python ----------
dam = DataDam(DataA=python.a, BufferDelay=10000000, BufferMode=0)

data = Data(from_flux)
list = ItemSelector(data, {"leisure", "family", "assisted", "business+", "business", "unique"}, selected="leisure")

geo = Geometry(flatten([pt_3, pt]))
geo_2 = Geometry(graft([pt_3, pt]))
ln = Line(StartPoint=graft(pt_4), EndPoint=pt_2)
ln_2 = Line(StartPoint=geo, EndPoint=geo_2)
ln_3 = Line(StartPoint=geo_2, EndPoint=pt_2)
template = PythonScript(lines=flatten([ln, ln_3, ln_2]))  # -> out, a; inputs lines: list of Curve
# ---------- template: Python ----------
import rhinoscriptsyntax as rs
import Rhino as rc


if len(lines):
    
    entities = []
    for line in lines:
        entities.append([rs.CurveEndPoint(line), rs.CurveStartPoint(line)])
    entity = {
        'type': 'template',
        'profile': {
            'edges': entities,
            'directed': False
        }
    }
    a = [entity]
# ---------- end template ----------

profile_7 = PythonScript()  # -> out, a
# ---------- profile_7: Python ----------
passenger_profile_departing = {
    'name':'passenger',
    'status': {
        'def':'departing',
        'origin':'curbside',
        'destination': 'gate'
    },
    'properties': {
        'curbside': 100,
        'bathroom':100,
        'security': 100,
        'gate': 100
    },
    'influence':{
        'queuing':0,
        'remainder':120
    }
    
}

a = [passenger_profile_departing]
# ---------- end profile_7 ----------
dup = DuplicateData(Data=profile_7.a, Number=Slider(50, range=0..100), Order=True)
agent = PythonScript(profile=flatten(dup))  # -> out, a; inputs profile: list
# ---------- agent: Python ----------
import rhinoscriptsyntax as rs
import copy, random

           
if len(profile) != 0:

    entities = []
    profile.reverse()

    while len(profile) > 0:
        entity = {
            'type': 'agent',
            'profile':profile[-1]
        }
        profile.pop()
        entities.append(entity)
        
    a = entities
# ---------- end agent ----------
number_slider = Slider(3, range=0..10)
env = PythonScript(entities=flatten([agent.a, floor.a, node_3.a, node_4.a, barrier.a, node_2.a, node.a, template.a]))  # -> out, a; inputs entities: list; disabled
# ---------- env: Python ----------
from collections import defaultdict
import rhinoscriptsyntax as rs
import Rhino as rc
import scriptcontext as sc
import random, copy
from itertools import permutations
import math as m

import ghpythonlib.parallel

class Graph(object):
    
    def __init__(self, nodes=set(), edges=defaultdict(set), distances={}):
        """
            currently resource allocation between graphs is broken
            multiple graphs share the same node set
        """
        self.nodes = nodes
        self.edges = edges
        self.distances = distances 

    def __repr__(self):
        return "Graph: {0} nodes, {1} edges".format(len(self.nodes), len(self.edges))
    
    def add_node(self, value):
        self.nodes.add(value)
        
    def add_edge(self, from_node, to_node, distance):
        self.add_node(from_node)
        self.add_node(to_node)
        
        self.edges[from_node].add(to_node)
        self.edges[to_node].add(from_node)
        self.distances[(from_node, to_node)] = distance
        self.distances[(to_node, from_node)] = distance
    
    
    def get_distance(self, key, gen=0):
        return self.distances[key]
    
    def get_step(self, initial, goal, route):
        return
    
    """
        dijsktra from:
        https://gist.github.com/econchick/4666413
    """
    def dijsktra(self, initial, goal=None, start_idx=0):

        visited = {initial: 0}
        path = {}
        nodes = set(self.nodes)

        while nodes:
            min_node = None
            for node in nodes:
                if node in visited:
                    if min_node is None:
                        min_node = node
                    elif visited[node] < visited[min_node]:
                        min_node = node
            if min_node is None:
                break
            nodes.remove(min_node)
            current_weight = visited[min_node]

            gen = self.get_step(min_node, initial, path)

            for edge in self.edges[min_node]:
                distance = self.get_distance((min_node, edge), gen+start_idx)
                weight = current_weight + distance
                if edge not in visited or weight < visited[edge]:
                    
                    visited[edge] = weight
                    path[edge] = min_node
                    
                if goal != None and edge == goal: return visited, path
                        
        return visited, path

    def shortest_path(self, initial_node, goal_node, start_idx=0, paths=None):
        
        if paths == None:
            distances, paths = self.dijsktra(initial_node, goal_node, start_idx)
            
        route = [goal_node]
        while goal_node != initial_node:
            route.append(paths[goal_node])
            goal_node = paths[goal_node]
        route.reverse()
        return route

class Map(Graph):
    
    def __init__(self, floor):
        super(Map, self).__init__()
        self._floor = floor
        self._barrier_map = defaultdict(float)
        self._density_map = defaultdict(lambda : defaultdict(int))
        
    @property
    def barrier_map(self):
        return self._barrier_map
    
    def set_barrier(self, key, val):
        self.barrier_map[key] += val
   
    def get_barrier_map(self):
        return [self.barrier_map[k] for k in self.barrier_map.keys()]
    
    
    @property
    def density_map(self):
        return self._density_map
    
    def get_density(self, key, gen):
        denom = (self.floor.grid_size / 3.28084) **2
        return self.density_map[gen][key] / denom
    
    def get_density_map_at(self, gen):
        return [self.get_density(k, gen) for k in range(len(self.floor.grid))]
    
    def add_density(self, key, gen):
        self.density_map[gen][key] += 1
    
        
    @property
    def floor(self):
        return self._floor
    
    def filter(self, key):
        return self.barrier_map[key]
    
    def get_step(self, initial, goal, route):
        path = [initial]
        while initial != goal:
            path.append(route[initial])
            initial = route[initial]
        curr_gen = len(path)
        return curr_gen
    
    def get_distance(self, key, gen):
        dist = self.distances[key]
        density  = self.get_density(key[1], gen)
        overlays = self.filter(key[1])
        
        return dist + overlays + density

class Bounds2d():
    
    def __init__(self, geo):
        self.geo_pts = rs.CurvePoints(geo)
        self._bds = [self.bds_x(self.geo_pts), self.bds_y(self.geo_pts)]
        self._origin = rc.Geometry.Point3d(self.bds[0][0], self.bds[1][0], 0)
        
        self._dim_x = self._bds[0][1] - self._bds[0][0]
        self._dim_y = self._bds[1][1] - self._bds[1][0]
        
    
    @property
    def pts(self):
        return [ rc.Geometry.Point3d(self.bds[0][0], self.bds[1][0], 0),
            rc.Geometry.Point3d(self.bds[0][1], self.bds[1][0], 0),
            rc.Geometry.Point3d(self.bds[0][1], self.bds[1][1], 0),
            rc.Geometry.Point3d(self.bds[0][0], self.bds[1][1], 0)]
    
    @property
    def bds(self):
        return self._bds
    
    @property
    def origin(self):
        return self._origin
    
    def set_origin(self, pt):
        self._origin = pt
    
    @property
    def plane(self):
        return rc.Geometry.Plane(self.origin, rc.Geometry.Vector3d(0,0,1))
    
    @property
    def x(self):
        return self.bds[0][0]
    
    @property
    def y(self):
        return self.bds[1][0]
    
    def bds_x(self, pts):
        pts.sort(key = lambda pt: pt.X)
        return (pts[0].X, pts[-1].X)
    
    def bds_y(self, pts):
        pts.sort(key = lambda pt: pt.Y)
        return (pts[0].Y, pts[-1].Y)
   
    @property
    def dim_x(self):
        return self._dim_x
    
    @property
    def dim_y(self):
        return self._dim_y
    
    @property
    def centroid(self):
        x_average = self.x + self.dim_x/2
        y_average = self.y + self.dim_y/2
        return rc.Geometry.Point3d(x_average, y_average, 0)
    
    def to_rect(self):
        return rc.Geometry.Rectangle3d(self.plane, self.dim_x, self.dim_y)
    
    def to_grid(self, grid_size):
        
        def mesh_from_rect(rect, grid_size):

            mesh_params = rc.Geometry.MeshingParameters.Default
            mesh_params.MaximumEdgeLength = grid_size
            mesh_params.MinimumEdgeLength = grid_size
            mesh_params.GridAspectRatio = 1

            rect = rc.Geometry.Rectangle3d.ToNurbsCurve(rect)
            return rc.Geometry.Mesh.CreateFromPlanarBoundary(rect, mesh_params)
        
        return mesh_from_rect(self.to_rect(), grid_size)
    
    def contains_pt(self, pt):
        pt = rs.coerce3dpoint(pt)
        if pt.X < self.x or pt.X > (self.x + self.dim_x) or pt.Y < self.y or pt.Y > (self.y + self.dim_y):
            return False
        return True


class Entity(object):
    
    def __init__(self, attr):
        self._pos = defaultdict(lambda: None)
        self._attr = attr
        self._type = 'entity'
    
    def __repr__(self):
        return "Environment Entity: {0} : {1} ".format(self.type, self.get_attribute('name'))

    @property
    def position(self):
        return self._pos[0]
    
    def set_position(self, pos, gen=0):
        self._pos[gen] = pos
    
    def get_position(self, gen=0):
        return self._pos[gen]
    
    @property
    def type(self):
        return self._type
    
    def set_type(self, type):
        self._type = type
    
    @property
    def attributes(self): return self._attr
    
    def set_attribute(self, key, value):
        self._attr[key] = value
    
    def get_attribute(self, key):
        
        def _finditem(obj, key):
            if key in obj: return obj[key]
            for k, v in obj.items():
                if isinstance(v,dict):
                    item = _finditem(v, key)
                    if item is not None:
                        return item
                        
        return _finditem(self.attributes, key)
    
    def has_attribute_value(self, val):
        
        def _findvalue(obj, val):
            if val in obj.values(): return True
            for k,v in obj.items():
                if isinstance(v,dict):
                    value = _findvalue(v, val)
                    if value is not None:
                        return True
            return False
        
        return _findvalue(self.attributes, val)


class Node(Entity):
    
    def __init__(self, pos, attr={}):
        super(Node, self).__init__(attr)
        self.set_position(pos)
        self.set_type('node')

        
class Template(Entity):
    
    def __init__(self, attr={}):
        super(Template, self).__init__(attr)
        self.set_type('template')
    
    @property
    def edges(self):
        return self.get_attribute('edges')

class Floor(Entity):
    
    def __init__(self, geo, attr={}):
        super(Floor, self).__init__(attr)
        self._geo = rs.coercecurve(geo)
        self._bds = Bounds2d(geo)
        self._map = None
        self._msh = None
        self._grid = None
        self._grid_size = None
        self._coords = {}
        
        self.set_position(self.bounds.origin)
        self.set_type('floor')
        
    @property
    def geo(self):
        return self._geo
    
    @property
    def bounds(self):
        return self._bds
    
    @property
    def mesh(self):
        return self._msh
        
    @property
    def map(self):
        return self._map
    
    
    @property
    def grid(self):
        return self._grid
        
    def set_grid(self, grid_size):
        
        indexes = []
        denom = m.sqrt(2*(grid_size**2))
        t_mesh = rs.coercemesh(rs.AddPlanarMesh(self.geo))
        self._msh = self.bounds.to_grid(grid_size)
        self._map = Map(self)
        self._grid_size = grid_size
        
        for i, cpt in enumerate(rs.MeshFaceCenters(self.mesh)):
            line = rc.Geometry.Line(cpt, rc.Geometry.Vector3d(0,0,1))
            if not rc.Geometry.Intersect.Intersection.MeshLine(t_mesh, line)[1]:
                indexes.append(i)

        self.mesh.Faces.DeleteFaces(indexes)
        self._grid = rs.MeshFaceCenters(self.mesh)
        
        for i, pt in enumerate(self.grid):
            self.set_coord(self.to_grid_coord(pt), i)
        
        for i, vertex in enumerate(self.mesh.Vertices):

            edges = self.mesh.TopologyVertices.ConnectedFaces(i)
            for e1 in edges:
                for e2 in edges:
                    if not e1 == e2:
                        weight = rs.Distance(self._grid[e1], self._grid[e2])/denom
                        self.map.add_edge(e1,e2, weight)
                        
        self.add_edge_map()
    
    @property
    def grid_size(self):
        return self._grid_size
    
    @property
    def coords(self):
        return self._coords
    
    def set_coord(self, key, val):
        self._coords[key] = val
    
    def get_index_at_coord(self, key):
        return self._coords[key]
    
    def to_grid_coord(self, pt):
        
        grid_x = self.bounds.dim_x / m.floor(self.bounds.dim_x / self.grid_size)
        grid_y = self.bounds.dim_y / m.floor(self.bounds.dim_y / self.grid_size)
        
        cs_x = m.floor(self.bounds.dim_x / grid_x)
        cs_y = m.floor(self.bounds.dim_y / grid_y)

        pt_x = m.floor((pt.X - self.position.X)/ grid_x)
        pt_y = m.floor((pt.Y - self.position.Y)/ grid_y)
        
        return (pt_x, pt_y)
    
    def to_grid_index(self, pt):
        
        coord = self.to_grid_coord(pt)
        return self.get_index_at_coord(coord)
    
    
    def add_edge_map(self):
        
        def _func(num):
            if num == 8: return 0
            else: return 0.5
            
        for i, pt in enumerate(self.grid):
            edges = self.map.edges[i]
            self.map.set_barrier(i, _func(len(edges)))
    
    def add_barrier_map(self, barrier):
        for i, pt in enumerate(self.grid):
            if barrier.bounds.contains_pt(pt):
                if rs.PointInPlanarClosedCurve(pt, barrier.geo):
                    self.map.set_barrier(i, float('inf'))
                    for e in self.map.edges[i]:
                        self.map.set_barrier(e, 0.5)

        
class Barrier(Entity):
    
    def __init__(self, geo, attr={}):
        super(Barrier, self).__init__(attr)
        self._geo = rs.coercecurve(geo)
        self._bds = Bounds2d(geo)
        
        self.set_position(self.bounds.origin)
        self.set_type('barrier')
        
    @property
    def geo(self):
        return self._geo
    
    @property
    def bounds(self):
        return self._bds
        

class Agent(Entity):
    
    def __init__(self, pos=None, attr={}, env=None):
        super(Agent, self).__init__(attr)
        self._attr = attr
        self._env = env
        self._state = None
        self._history = []
        self._path = []
        
        self.set_position(pos)
        self.set_type('agent')
        
        self.age = 0
        self.__hold = None
        self.is_active = True
        self.is_complete = False
                
    
    @property
    def position(self):
        return self.get_position(self.age)
        
    @property
    def grid_index(self):
        return self.environment.floors[0].to_grid_index(self.position.position)
    
    @property
    def state(self):
        return self._state
    
    def set_state(self, state):
        self._state = state
    
    @property
    def destination(self):
        val = self.get_attribute('destination')
        return random.choice(self.environment.get_nodes_with_value(val))
    
    
    
    @property
    def path(self):
        return sum([p for p in self._path], [])
    
    def add_path(self, path):
        self._path.append(path)
    
    
    
    @property
    def history(self):
        return self._history
    
    @property
    def visited(self):
        """
            TODO - this needs to become more standard - maybe a property of the node?
        """
        return [n.get_attribute('name') for n in self.history if not type(n) == int]
    
    
    @property
    def environment(self):
        return self._env
    
    def set_environment(self, env):
        self._env = env
        
    def toggle_active(self):
        self.is_active = not self.is_active
        
    def toggle_complete(self):
        self.is_complete = not self.is_complete
    
    def step(self):        
        
       
        def wait(time):
            print 'waiting...'
            return self.position, [self.position] * time
    
    
        def move(lst):
            
            lst = [l for l in lst if not l.get_attribute('name') in self.visited]
            
            if len(lst):
            
                properties = self.get_attribute('properties')
                keys = properties.keys()
                n_percs = [k for k in keys if random.randint(0,100) <= properties[k]]
                
                lst = [(l, self.environment.graph.get_distance((self.position, l))) for l in lst if l.get_attribute('name') in n_percs]
            
                if len(lst):
                    
                    lst.sort(key = lambda tup: len(tup[1]))
                    lst.reverse()
                    
                    while len(lst):
    
                        tup = lst.pop()
                        n_choice = tup[0]
                        
                        """
                            TODO - switch agents_at_position to consider generation
                                 this currently looks at the amount of people with the same destination
                        """
                        #num_people = len(self.environment.agents_at_position(n_choice, self.age))
                        num_people = len([a for a in self.environment.agents if self.__hold == a.__hold and a != self])
                        capacity = n_choice.get_attribute('capacity')

                        
                        if capacity != None:
                            
                            if num_people < float(capacity):
                                
                                print 'no line ', n_choice, num_people, 'ppl', 'capacity', capacity
                                break
                                
                            else:
                                
                                if random.randint(0,100) < self.get_attribute('queuing'):
                                    
                                    print 'queuing', n_choice, num_people, 'ppl', ', capacity: ', capacity
                                    break
                                    
                                else: 
                                    print 'too many people in line', n_choice, num_people, 'ppl'
                        else:
                            break
                else:
                    n_choice = self.destination
                    print 'no option chosen: go to final destination', n_choice
            else:
                n_choice = self.destination
                print 'all options visited: go to final destination', n_choice
                self.toggle_complete()
            
            """
                TODO - replace with entity.to_grid_index(environment)
            """
            n_index = self.environment.floors[0].to_grid_index(n_choice.position)
            n_path = self.environment.floors[0].map.shortest_path(self.grid_index, n_index, start_idx=self.age)
            
            return n_choice, n_path


        if not len(self.history):

            start_node = self.get_attribute('origin')
            start_positions = self.environment.get_nodes_with_value(start_node)
            start_position = random.choice(start_positions)
            
            self.set_position(start_position)
            self.set_state('waiting')
            print 'agent init'
            
        else:

            if self.is_active:
                
                print 'state: ', self.state
                print 'age: ', self.age
                print 'position: ', self.position, 'currently', len(self.environment.agents_at_position(self.position, self.age)), 'ppl'
                
                #print 'other agent positions: '
                #for p in [a.position for a in self.environment.agents if not a == self]:
                    #print '     ', p
                    
                if self.state == 'ready':
                    
                    self.__hold, path = move(self.environment.graph.edges[self.position])
                    self.add_path([self.environment.floors[0].grid[i] for i in path])
                    
                    for pi in range(len(path)):
                        self.environment.floors[0].map.add_density(path[pi], self.age+pi)
                        self.set_position(path[pi], self.age+pi)
                    
                    path.reverse()
                    self.set_state(path)
                    
                    print 'chose new goal: ', self.__hold, 'currenty', len(self.environment.agents_at_position(self.__hold, self.age)), 'ppl'
               
                if self.state == 'waiting':
                    
                    num_people = len(self.environment.agents_at_position(self.__hold, self.age))+1
                    """
                        Wait time set to random for now
                    """
                    wait_time = random.randint(1,10) * num_people
                    
                    self.__hold, path = wait(wait_time)
                    self.add_path([self.grid_index] * wait_time)
                    
                    for pi in range(len(path)):
                        self.environment.floors[0].map.add_density(self.grid_index, self.age+pi)
                        self.set_position(path[pi], self.age+pi)
                    
                    path.reverse()
                    self.set_state(path)
               
                elif len(self.state) == 1:
                    
                    self.set_position(self.__hold, self.age)
                    
                    if self.is_complete:
                        self.set_state('complete')
                        print 'final position:', self.position, len(self.environment.agents_at_position(self.position, self.age)), 'ppl'
                        self.toggle_active()
                    else:
                        if self.position == self.state[0]:
                            self.set_state('ready')
                            print 'ready position:', self.position, len(self.environment.agents_at_position(self.position, self.age)), 'ppl'
                        else:
                            self.set_state('waiting')
                            print 'waiting position:', self.position, len(self.environment.agents_at_position(self.position, self.age)), 'ppl'
                else:
                    self.age+=1
                    self.state.pop()
                    print 'walking to: ', self.__hold, len(self.environment.agents_at_position(self.__hold, self.age)), 'ppl'

        self.history.append(self.position)
        
        
        
class Environment():
    
    def __init__(self, resolution=30):
        self._entities = defaultdict(list)
        self._agents = []
        self._graph = copy.deepcopy(Graph()) # bad - fix later
        self._graph_paths = {}
        self._resolution = resolution
    
    def __repr__(self):
        return 'Environment: {0} agents, {1} nodes, {2} floors'.format(len(self.agents), len(self.graph.nodes), len(self.floors))
    
    @property
    def resolution(self):
        return self._resolution
    
    
    @property
    def entities(self):
        return self._entities
     
    def add_entity(self, entity):
        self.entities[entity.type].append(entity)
    
    def add_entities(self, entities):
        
        def _add_floor(entity):
            entity = Floor(entity['geometry'], entity['profile'])
            self.add_floor(entity)
            self.add_entity(entity)
        
        def _add_node(entity):
            entity = Node(entity['position'], entity['profile'])
            self.add_node(entity)
            self.add_entity(entity)
            
        def _add_template(entity):
            entity = Template(entity['profile'])
            self.add_template(entity)
            self.add_entity(entity)
        
        def _add_barrier(entity):
            entity = Barrier(entity['geometry'], entity['profile'])
            self.add_barrier(entity)
            self.add_entity(entity)
        
        def _add_agent(entity):
            entity = Agent(attr=entity['profile'])
            self.add_agent(entity)
            self.add_entity(entity)
        
        
        dict = defaultdict(list)
        for entity in entities:
            dict[entity['type']].append(entity)
        
        if len(dict['floor']):
            for  floor in dict['floor']:
                _add_floor(floor)
        else:
            """
                TODO - return a warning
            """
            print 'environment needs at least one floor to run'
            
        if len(dict['node']):
            ghpythonlib.parallel.run(_add_node, dict['node'], False)
            #for node in dict['node']:
            #    _add_node(node)
        else:
            """
                TODO - return a warning
            """
            print 'environment needs at least two nodes to run'
        
        if len(dict['template']):
            for template in dict['template']:
                _add_template(template)
        else: self.add_default_template()

        if len(dict['barrier']):
            for barrier in dict['barrier']:
                _add_barrier(barrier)
            
        if len(dict['agent']):
            for agent in dict['agent']:
                _add_agent(agent)
        else:
            """
                TODO - return a warning
            """
            print 'environment needs at least one agent to run'


    @property
    def graph(self):
        return self._graph
    
    @property
    def graph_paths(self):
        return self._graph_paths
    
    def get_graph_path(self, n1, n2):
        
        floor = self.floors[0] # bad - fix later
        idx1 = floor.to_grid_index(n1.position)
        idx2 = floor.to_grid_index(n2.position)
        return floor.map.shortest_path(idx1, idx2, paths=self.graph_paths[n1])
    
    def set_graph_path(self, key, val):
        self._graph_paths[key] = val
    
    
    @property
    def templates(self):
        return [n for n in self.entities['template']]
    
    def add_template(self, template):
        if template.get_attribute('directed') == False:
            for edge in template.edges:
                nodes = [n for n in self.nodes if n.position in edge]
                if len(nodes) == 2:
                    path = self.get_graph_path(nodes[0], nodes[1])
                    self.graph.add_edge(nodes[0], nodes[1], path)
    
    def add_default_template(self):
        for n1 in self.graph.nodes:
            for n2 in self.graph.nodes:
                if not n1 == n2: 
                    path = self.get_graph_path(n1, n2)
                    self.graph.add_edge(n1, n2, path)
    
    
    @property
    def agents(self):
        return self._agents
        
    def add_agent(self, agent, other=None):
        agent.set_environment(self)
        self.agents.append(agent)
    
    def agents_at_position(self, position, gen=0):
        return [a for a in self.agents if a.get_position(gen) == position]
        #return [a for a in self.agents if a.position == position]
    
    
    @property
    def nodes(self):
        return [n for n in self.entities['node']]
    
    def add_node(self, node):
        self.graph.add_node(node)
        """
            TODO - floors need to be referenced better
        """
        djk = self.floors[0].map.dijsktra(self.floors[0].to_grid_index(node.position))
        self.set_graph_path(node, djk[1])
    
    def get_nodes_with_value(self, val):
        return [n for n in self.nodes if n.has_attribute_value(val)]
    
    
    @property
    def floors(self):
        return [n for n in self.entities['floor']]
    
    def add_floor(self, floor):
        floor.set_grid(self.resolution)
    
    def set_grid(self, grid_size):
        
        """
            TODO - implement more complexity
            grids will need to match up between floors
               - maybe 1 unified graph to hold graphs?
        """
        for floor in self.floors: floor.set_grid(grid_size)
    
    
    @property
    def paths(self):
        return [a.path for a in self.agents]
    
    def add_barrier(self, barrier):
        
        """
            TODO - implement multiple floors: barriers should be declared with
            their floor identifier.
            single floor use only for now
        """
        for floor in self.floors:
            floor.add_barrier_map(barrier)
    
    
    def generation(self, gen):
        return [a.get_position(gen) for a in self.agents]

    def step(self):
        
        def _func(agent):
            if agent.is_active:
                agent.step()
        
        print '#####################################'
        print 'NEW STEP'
        #ghpythonlib.parallel.run(_func, self.agents, False)
        for i, agent in enumerate(self.agents):
            print 'agent', i
            _func(agent)
    
    def run(self):
        while len([a for a in self.agents if a.is_active]):
            self.step()
        

if len(entities) != 0 and res != None:
    environment = Environment(resolution=res)
    environment.add_entities(entities)
    
    a = environment
# ---------- end env ----------
env_2 = PythonScript(entities=flatten([agent.a, floor.a, node_3.a, node_4.a, barrier.a, node_2.a, node.a, template.a]), res=number_slider)  # -> out, a; inputs entities: list
# ---------- env_2: Python ----------
from collections import defaultdict
import rhinoscriptsyntax as rs
import Rhino as rc
import scriptcontext as sc
import random, copy
from itertools import permutations
import math as m

import ghpythonlib.parallel

class Graph(object):
    
    def __init__(self, nodes=set(), edges=defaultdict(set), distances={}):
        """
            currently resource allocation between graphs is broken
            multiple graphs share the same node set
        """
        self.nodes = nodes
        self.edges = edges
        self.distances = distances 

    def __repr__(self):
        return "Graph: {0} nodes, {1} edges".format(len(self.nodes), len(self.edges))
    
    def add_node(self, value):
        self.nodes.add(value)
        
    def add_edge(self, from_node, to_node, distance):
        self.add_node(from_node)
        self.add_node(to_node)
        
        self.edges[from_node].add(to_node)
        self.edges[to_node].add(from_node)
        self.distances[(from_node, to_node)] = distance
        self.distances[(to_node, from_node)] = distance
    
    
    def get_distance(self, key, gen=0):
        return self.distances[key]
    
    def get_step(self, initial, goal, route):
        return
    
    """
        initial dijsktra from:
        https://gist.github.com/econchick/4666413
    """
    def dijsktra(self, initial, goal=None, start_idx=0):

        visited = {initial: 0}
        path = {}
        nodes = set(self.nodes)

        while nodes:
            min_node = None
            for node in nodes:
                if node in visited:
                    if min_node is None:
                        min_node = node
                    elif visited[node] < visited[min_node]:
                        min_node = node
            if min_node is None:
                break
            nodes.remove(min_node)
            current_weight = visited[min_node]

            gen = self.get_step(min_node, initial, path)

            for edge in self.edges[min_node]:
                distance = self.get_distance((min_node, edge), gen+start_idx)
                weight = current_weight + distance
                if edge not in visited or weight < visited[edge]:
                    
                    visited[edge] = weight
                    path[edge] = min_node
                    
                if goal != None and edge == goal: return visited, path
                        
        return visited, path

    def shortest_path(self, initial_node, goal_node, start_idx=0, paths=None):
        
        if paths == None:
            distances, paths = self.dijsktra(initial_node, goal_node, start_idx)
            
        route = [goal_node]
        while goal_node != initial_node:
            route.append(paths[goal_node])
            goal_node = paths[goal_node]
        route.reverse()
        return route

class Map(Graph):
    
    def __init__(self, floor):
        super(Map, self).__init__()
        self._floor = floor
        self._barrier_map = defaultdict(float)
        self._density_map = defaultdict(lambda : defaultdict(int))
        
    @property
    def barrier_map(self):
        return self._barrier_map
    
    def set_barrier(self, key, val):
        self.barrier_map[key] += val
   
    def get_barrier_map(self):
        return [self.barrier_map[k] for k in self.barrier_map.keys()]
    
    def shift(self, key, num):
        """
            INFO - probably a terrible idea
        """
        pass
    
    @property
    def density_map(self):
        return self._density_map
    
    def get_density(self, key, gen):
        denom = (self.floor.grid_size / 3.28084) **2
        return self.density_map[gen][key] / denom
    
    def get_density_map_at(self, gen):
        return [self.get_density(k, gen) for k in range(len(self.floor.grid))]
    
    def add_density(self, key, gen):
        self.density_map[gen][key] += 1
    
        
    @property
    def floor(self):
        return self._floor
    
    def filter(self, key):
        return self.barrier_map[key]
    
    def get_step(self, initial, goal, route):
        path = [initial]
        while initial != goal:
            path.append(route[initial])
            initial = route[initial]
        curr_gen = len(path)
        return curr_gen
    
    def get_distance(self, key, gen):
        dist = self.distances[key]
        density  = self.get_density(key[1], gen)
        overlays = self.filter(key[1])
        
        return dist + overlays + density

class Bounds2d():
    
    def __init__(self, geo):
        self.geo_pts = rs.CurvePoints(geo)
        self._bds = [self.bds_x(self.geo_pts), self.bds_y(self.geo_pts)]
        self._origin = rc.Geometry.Point3d(self.bds[0][0], self.bds[1][0], 0)
        
        self._dim_x = self._bds[0][1] - self._bds[0][0]
        self._dim_y = self._bds[1][1] - self._bds[1][0]
        
    
    @property
    def pts(self):
        return [ rc.Geometry.Point3d(self.bds[0][0], self.bds[1][0], 0),
            rc.Geometry.Point3d(self.bds[0][1], self.bds[1][0], 0),
            rc.Geometry.Point3d(self.bds[0][1], self.bds[1][1], 0),
            rc.Geometry.Point3d(self.bds[0][0], self.bds[1][1], 0)]
    
    @property
    def bds(self):
        return self._bds
    
    @property
    def origin(self):
        return self._origin
    
    def set_origin(self, pt):
        self._origin = pt
    
    @property
    def plane(self):
        return rc.Geometry.Plane(self.origin, rc.Geometry.Vector3d(0,0,1))
    
    @property
    def x(self):
        return self.bds[0][0]
    
    @property
    def y(self):
        return self.bds[1][0]
    
    def bds_x(self, pts):
        pts.sort(key = lambda pt: pt.X)
        return (pts[0].X, pts[-1].X)
    
    def bds_y(self, pts):
        pts.sort(key = lambda pt: pt.Y)
        return (pts[0].Y, pts[-1].Y)
   
    @property
    def dim_x(self):
        return self._dim_x
    
    @property
    def dim_y(self):
        return self._dim_y
    
    @property
    def centroid(self):
        x_average = self.x + self.dim_x/2
        y_average = self.y + self.dim_y/2
        return rc.Geometry.Point3d(x_average, y_average, 0)
    
    def to_rect(self):
        return rc.Geometry.Rectangle3d(self.plane, self.dim_x, self.dim_y)
    
    def to_grid(self, grid_size):
        
        def mesh_from_rect(rect, grid_size):

            mesh_params = rc.Geometry.MeshingParameters.Default
            mesh_params.MaximumEdgeLength = grid_size
            mesh_params.MinimumEdgeLength = grid_size
            mesh_params.GridAspectRatio = 1

            rect = rc.Geometry.Rectangle3d.ToNurbsCurve(rect)
            return rc.Geometry.Mesh.CreateFromPlanarBoundary(rect, mesh_params)
        
        return mesh_from_rect(self.to_rect(), grid_size)
    
    def contains_pt(self, pt):
        pt = rs.coerce3dpoint(pt)
        if pt.X < self.x or pt.X > (self.x + self.dim_x) or pt.Y < self.y or pt.Y > (self.y + self.dim_y):
            return False
        return True


class Entity(object):
    
    def __init__(self, attr):
        self._pos = defaultdict(lambda: None)
        self._attr = attr
        self._type = 'entity'
    
    def __repr__(self):
        return "Environment Entity: {0} : {1} ".format(self.type, self.get_attribute('name'))

    @property
    def position(self):
        return self._pos[0]
    
    def set_position(self, pos, gen=0):
        self._pos[gen] = pos
    
    def get_position(self, gen=0):
        return self._pos[gen]
    
    @property
    def type(self):
        return self._type
    
    def set_type(self, type):
        self._type = type
    
    @property
    def attributes(self): return self._attr
    
    def set_attribute(self, key, value):
        self._attr[key] = value
    
    def get_attribute(self, key):
        
        def _finditem(obj, key):
            if key in obj: return obj[key]
            for k, v in obj.items():
                if isinstance(v,dict):
                    item = _finditem(v, key)
                    if item is not None:
                        return item
                        
        return _finditem(self.attributes, key)
    
    def has_attribute_value(self, val):
        
        def _findvalue(obj, val):
            if val in obj.values(): return True
            for k,v in obj.items():
                if isinstance(v,dict):
                    value = _findvalue(v, val)
                    if value is not None:
                        return True
            return False
        
        return _findvalue(self.attributes, val)


class Node(Entity):
    
    def __init__(self, pos, attr={}):
        super(Node, self).__init__(attr)
        self.set_position(pos)
        self.set_type('node')

        
class Template(Entity):
    
    def __init__(self, attr={}):
        super(Template, self).__init__(attr)
        self.set_type('template')
    
    @property
    def edges(self):
        return self.get_attribute('edges')

class Floor(Entity):
    
    def __init__(self, geo, attr={}):
        super(Floor, self).__init__(attr)
        self._geo = rs.coercecurve(geo)
        self._bds = Bounds2d(geo)
        self._map = None
        self._msh = None
        self._grid = None
        self._grid_size = None
        self._coords = {}
        
        self.set_position(self.bounds.origin)
        self.set_type('floor')
        
    @property
    def geo(self):
        return self._geo
    
    @property
    def bounds(self):
        return self._bds
    
    @property
    def mesh(self):
        return self._msh
        
    @property
    def map(self):
        return self._map
    
    
    @property
    def grid(self):
        return self._grid
        
    def set_grid(self, grid_size):
        
        indexes = []
        denom = m.sqrt(2*(grid_size**2))
        t_mesh = rs.coercemesh(rs.AddPlanarMesh(self.geo))
        self._msh = self.bounds.to_grid(grid_size)
        self._map = Map(self)
        self._grid_size = grid_size
        
        for i, cpt in enumerate(rs.MeshFaceCenters(self.mesh)):
            line = rc.Geometry.Line(cpt, rc.Geometry.Vector3d(0,0,1))
            if not rc.Geometry.Intersect.Intersection.MeshLine(t_mesh, line)[1]:
                indexes.append(i)

        self.mesh.Faces.DeleteFaces(indexes)
        self._grid = rs.MeshFaceCenters(self.mesh)
        
        for i, pt in enumerate(self.grid):
            self.set_coord(self.to_grid_coord(pt), i)
        
        for i, vertex in enumerate(self.mesh.Vertices):

            edges = self.mesh.TopologyVertices.ConnectedFaces(i)
            for e1 in edges:
                for e2 in edges:
                    if not e1 == e2:
                        weight = rs.Distance(self._grid[e1], self._grid[e2])/denom
                        self.map.add_edge(e1,e2, weight)
                        
        self.add_edge_map()
    
    @property
    def grid_size(self):
        return self._grid_size
    
    @property
    def coords(self):
        return self._coords
    
    def set_coord(self, key, val):
        self._coords[key] = val
    
    def get_index_at_coord(self, key):
        return self._coords[key]
    
    def to_grid_coord(self, pt):
        
        grid_x = self.bounds.dim_x / m.floor(self.bounds.dim_x / self.grid_size)
        grid_y = self.bounds.dim_y / m.floor(self.bounds.dim_y / self.grid_size)
        
        cs_x = m.floor(self.bounds.dim_x / grid_x)
        cs_y = m.floor(self.bounds.dim_y / grid_y)

        pt_x = m.floor((pt.X - self.position.X)/ grid_x)
        pt_y = m.floor((pt.Y - self.position.Y)/ grid_y)
        
        return (pt_x, pt_y)
    
    def to_grid_index(self, pt):
        
        coord = self.to_grid_coord(pt)
        return self.get_index_at_coord(coord)
    
    
    def add_edge_map(self):
        
        def _func(num):
            if num == 8: return 0
            else: return 0.5
            
        for i, pt in enumerate(self.grid):
            edges = self.map.edges[i]
            self.map.set_barrier(i, _func(len(edges)))
    
    def add_barrier_map(self, barrier):
        for i, pt in enumerate(self.grid):
            if barrier.bounds.contains_pt(pt):
                if rs.PointInPlanarClosedCurve(pt, barrier.geo):
                    self.map.set_barrier(i, float('inf'))
                    for e in self.map.edges[i]:
                        self.map.set_barrier(e, 0.5)

        
class Barrier(Entity):
    
    def __init__(self, geo, attr={}):
        super(Barrier, self).__init__(attr)
        self._geo = rs.coercecurve(geo)
        self._bds = Bounds2d(geo)
        
        self.set_position(self.bounds.origin)
        self.set_type('barrier')
        
    @property
    def geo(self):
        return self._geo
    
    @property
    def bounds(self):
        return self._bds
        

class Agent(Entity):
    
    def __init__(self, pos=None, attr={}, env=None):
        super(Agent, self).__init__(attr)
        self._attr = attr
        self._env = env
        self._state = None
        self._history = []
        self._path = []
        
        self.set_position(pos)
        self.set_type('agent')
        
        self.age = 0
        self.__hold = None
        self.is_active = True
        self.is_complete = False
                
    
    @property
    def position(self):
        return self.get_position(self.age)
        
    def shift(self, num):
        _index =  self._path[-1].index(self.state[-2])
        self._path[-1].insert(_index, self.state[-2])
        self.history.append(self.position)
        """
        self.environment.floors[0].map.add_density(path[pi], self.age+pi)
        self.set_position(path[pi], self.age+pi)
        """
        
        """
            TODO - not clean at all - Make this better
        """
        keys = self._pos.keys()
        keys.sort()
        keys = keys[self.age:]
        keys.reverse()
        _dict = copy.copy(self._pos)
        for ki in range(len(keys)):
            _dict[keys[ki]+1] = _dict[keys[ki]]
        self._pos = _dict
        
        
    @property
    def grid_index(self):
        return self.environment.floors[0].to_grid_index(self.position.position)
    
    @property
    def state(self):
        return self._state
    
    def set_state(self, state):
        self._state = state
    
    @property
    def destination(self):
        val = self.get_attribute('destination')
        return random.choice(self.environment.get_nodes_with_value(val))
    
    
    
    @property
    def path(self):
        _path = sum([p for p in self._path], [])
        _dict = {idx: self.environment.floors[0].grid[idx] for idx in set(_path)}
        return [_dict[p] for p in _path]
    
    def add_path(self, path):
        self._path.append(copy.deepcopy(path))    
    
    @property
    def history(self):
        return self._history
    
    @property
    def visited(self):
        """
            TODO - this needs to become more standard - maybe a name property of the node?
        """
        return [n.get_attribute('name') for n in self.history if not type(n) == int]
    
    
    @property
    def environment(self):
        return self._env
    
    def set_environment(self, env):
        self._env = env
        
    def toggle_active(self):
        self.is_active = not self.is_active
        
    def toggle_complete(self):
        self.is_complete = not self.is_complete
    
    def step(self):        
        
       
        def wait(time):
            return self.position, [self.position] * time
    
    
        def move(lst):
            
            lst = [l for l in lst if not l.get_attribute('name') in self.visited]
            
            if len(lst):
            
                properties = self.get_attribute('properties')
                keys = properties.keys()
                n_percs = [k for k in keys if random.randint(0,100) <= properties[k]]
                
                lst = [(l, self.environment.graph.get_distance((self.position, l))) for l in lst if l.get_attribute('name') in n_percs]
            
                if len(lst):
                    
                    lst.sort(key = lambda tup: len(tup[1]))
                    lst.reverse()
                    ncount=0
                    while len(lst) and ncount < 1000 :
                        
                        ncount+=1
                        if ncount ==100: print ">>>>>>>>>>>>>>>>>> broke inner while loop"
                        tup = lst.pop()
                        n_choice = tup[0]
                        
                        """
                            TODO - switch agents_at_position to consider generation
                                 this currently looks at the amount of people with the same destination
                                 insead of num_people = len(self.environment.agents_at_position(n_choice, self.age))
                        """
                        num_people = len([a for a in self.environment.agents if self.__hold == a.__hold and a != self])
                        capacity = n_choice.get_attribute('capacity')

                        if capacity != None:
                            if num_people < float(capacity):
                                break
                            else:
                                if random.randint(0,100) < self.get_attribute('queuing'):
                                    break
                                else: 
                                    continue
                        else:
                            break
                else:
                    n_choice = self.destination
            else:
                n_choice = self.destination
                self.toggle_complete()
            
            """
                TODO - replace with entity.to_grid_index(environment)
            """
            n_index = self.environment.floors[0].to_grid_index(n_choice.position)
            n_path = self.environment.floors[0].map.shortest_path(self.grid_index, n_index, start_idx=self.age)
            
            return n_choice, n_path


        if not len(self.history):

            start_node = self.get_attribute('origin')
            start_positions = self.environment.get_nodes_with_value(start_node)
            start_position = random.choice(start_positions)
            
            self.set_position(start_position)
            self.set_state('waiting')
            
        else:

            if self.is_active:
                
                #print 'position: ', self.position, 'currently', len(self.environment.agents_at_position(self.position, self.age)), 'ppl'
                #print 'state: ', self.state
                
                
                if self.state == 'ready':
                    
                    self.__hold, path = move(self.environment.graph.edges[self.position])
                    self.add_path(path)
                    
                    for pi in range(len(path)):
                        self.environment.floors[0].map.add_density(path[pi], self.age+pi)
                        self.set_position(path[pi], self.age+pi)
                    
                    path.reverse()
                    self.set_state(path)
               
               
                if self.state == 'waiting':
                    
                    num_people = len(self.environment.agents_at_position(self.__hold, self.age))+1
                    """
                        Wait time set to random for now
                    """
                    wait_time = random.randint(1,3) * num_people
                    
                    self.__hold, path = wait(wait_time)
                    self.add_path([self.grid_index] * wait_time)
                    
                    for pi in range(len(path)):
                        self.environment.floors[0].map.add_density(self.grid_index, self.age+pi)
                        self.set_position(path[pi], self.age+pi)
                    
                    path.reverse()
                    self.set_state(path)
               
               
                elif len(self.state) == 1:
                    
                    self.set_position(self.__hold, self.age)
                    
                    if self.is_complete:
                        self.set_state('complete')
                        self.toggle_active()
                    else:
                        if self.position == self.state[0]:
                            self.set_state('ready')
                        else:
                            self.set_state('waiting')
                            
                            
                else:
                    
                    index = self.state[-2]
                    num_people = len(self.environment.agents_at_position(index, self.age))
                    if num_people >0 and type(index) != Node :
                        #print ' ##################################################################### wait'
                        self.state.append(self.position)
                        self.shift(1)

                    self.age+=1
                    self.state.pop()

        self.history.append(self.position)
        
        
        
class Environment():
    
    def __init__(self, resolution=30):
        self._entities = defaultdict(list)
        self._agents = []
        self._graph = copy.deepcopy(Graph()) # bad - fix later
        self._graph_paths = {}
        self._resolution = resolution
    
    def __repr__(self):
        return 'Environment: {0} agents, {1} nodes, {2} floors'.format(len(self.agents), len(self.graph.nodes), len(self.floors))
    
    @property
    def resolution(self):
        return self._resolution
    
    
    @property
    def entities(self):
        return self._entities
     
    def add_entity(self, entity):
        self.entities[entity.type].append(entity)
    
    def add_entities(self, entities):
        
        def _add_floor(entity):
            entity = Floor(entity['geometry'], entity['profile'])
            self.add_floor(entity)
            self.add_entity(entity)
        
        def _add_node(entity):
            entity = Node(entity['position'], entity['profile'])
            self.add_node(entity)
            self.add_entity(entity)
            
        def _add_template(entity):
            entity = Template(entity['profile'])
            self.add_template(entity)
            self.add_entity(entity)
        
        def _add_barrier(entity):
            entity = Barrier(entity['geometry'], entity['profile'])
            self.add_barrier(entity)
            self.add_entity(entity)
        
        def _add_agent(entity):
            entity = Agent(attr=entity['profile'])
            self.add_agent(entity)
            self.add_entity(entity)
        
        
        dict = defaultdict(list)
        for entity in entities:
            dict[entity['type']].append(entity)
        
        if len(dict['floor']):
            for  floor in dict['floor']:
                _add_floor(floor)
        else:
            """
                TODO - return a warning
            """
            print 'environment needs at least one floor to run'
            
        if len(dict['node']):
            ghpythonlib.parallel.run(_add_node, dict['node'], False)
            #for node in dict['node']:
            #    _add_node(node)
        else:
            """
                TODO - return a warning
            """
            print 'environment needs at least two nodes to run'
        
        if len(dict['template']):
            for template in dict['template']:
                _add_template(template)
        else: self.add_default_template()

        if len(dict['barrier']):
            for barrier in dict['barrier']:
                _add_barrier(barrier)
            
        if len(dict['agent']):
            for agent in dict['agent']:
                _add_agent(agent)
        else:
            """
                TODO - return a warning
            """
            print 'environment needs at least one agent to run'


    @property
    def graph(self):
        return self._graph
    
    @property
    def graph_paths(self):
        return self._graph_paths
    
    def get_graph_path(self, n1, n2):
        
        floor = self.floors[0] # bad - fix later
        idx1 = floor.to_grid_index(n1.position)
        idx2 = floor.to_grid_index(n2.position)
        return floor.map.shortest_path(idx1, idx2, paths=self.graph_paths[n1])
    
    def set_graph_path(self, key, val):
        self._graph_paths[key] = val
    
    
    @property
    def templates(self):
        return [n for n in self.entities['template']]
    
    def add_template(self, template):
        if template.get_attribute('directed') == False:
            for edge in template.edges:
                nodes = [n for n in self.nodes if n.position in edge]
                if len(nodes) == 2:
                    path = self.get_graph_path(nodes[0], nodes[1])
                    self.graph.add_edge(nodes[0], nodes[1], path)
    
    def add_default_template(self):
        for n1 in self.graph.nodes:
            for n2 in self.graph.nodes:
                if not n1 == n2: 
                    path = self.get_graph_path(n1, n2)
                    self.graph.add_edge(n1, n2, path)
    
    
    @property
    def agents(self):
        return self._agents
        
    def add_agent(self, agent, other=None):
        agent.set_environment(self)
        self.agents.append(agent)
    
    def agents_at_position(self, position, gen=0):
        return [a for a in self.agents if a.get_position(gen) == position]
        #return [a for a in self.agents if a.position == position]
    
    
    @property
    def nodes(self):
        return [n for n in self.entities['node']]
    
    def add_node(self, node):
        self.graph.add_node(node)
        """
            TODO - floors need to be referenced better
        """
        djk = self.floors[0].map.dijsktra(self.floors[0].to_grid_index(node.position))
        self.set_graph_path(node, djk[1])
    
    def get_nodes_with_value(self, val):
        return [n for n in self.nodes if n.has_attribute_value(val)]
    
    
    @property
    def floors(self):
        return [n for n in self.entities['floor']]
    
    def add_floor(self, floor):
        floor.set_grid(self.resolution)
    
    def set_grid(self, grid_size):
        
        """
            TODO - implement more complexity
            grids will need to match up between floors
               - maybe 1 unified graph to hold graphs?
        """
        for floor in self.floors: floor.set_grid(grid_size)
    
    
    @property
    def paths(self):
        return [a.path for a in self.agents]
    
    def add_barrier(self, barrier):
        
        """
            TODO - implement multiple floors: barriers should be declared with
            their floor identifier.
            single floor use only for now
        """
        for floor in self.floors:
            floor.add_barrier_map(barrier)
    
    
    def generation(self, gen):
        return [a.get_position(gen) for a in self.agents]

    def step(self):
        
        def _func(agent):
            if agent.is_active:
                agent.step()
        
        #print '______________________________________________________'
        #print 'NEW STEP'
        #ghpythonlib.parallel.run(_func, self.agents, False)
        for i, agent in enumerate(self.agents):
            #print 'agent', i
            _func(agent)
    
    def run(self):
        count = 0
        while len([a for a in self.agents if a.is_active]) and count < 1000:
            self.step()
            count+=1
            if count ==500: print ">>>>>>>>>>>>>>>>>>>>>>>>> broke outer while loop"
        

if len(entities) != 0 and res != None:
    environment = Environment(resolution=res)
    environment.add_entities(entities)
    
    a = environment
# ---------- end env_2 ----------
# ---- group: good example of broken
env_3 = PythonScript(entities=flatten([agent.a, floor.a, node_3.a, node_4.a, barrier.a, node_2.a, node.a, template.a]), res=number_slider)  # -> out, a; inputs entities: list; disabled
# ---------- env_3: Python ----------
from collections import defaultdict
import rhinoscriptsyntax as rs
import Rhino as rc
import scriptcontext as sc
import random, copy
from itertools import permutations
import math as m

import ghpythonlib.parallel

class Graph(object):
    
    def __init__(self, nodes=set(), edges=defaultdict(set), distances={}):
        """
            currently resource allocation between graphs is broken
            multiple graphs share the same node set
        """
        self.nodes = nodes
        self.edges = edges
        self.distances = distances 

    def __repr__(self):
        return "Graph: {0} nodes, {1} edges".format(len(self.nodes), len(self.edges))
    
    def add_node(self, value):
        self.nodes.add(value)
        
    def add_edge(self, from_node, to_node, distance):
        self.add_node(from_node)
        self.add_node(to_node)
        
        self.edges[from_node].add(to_node)
        self.edges[to_node].add(from_node)
        self.distances[(from_node, to_node)] = distance
        self.distances[(to_node, from_node)] = distance
    
    
    def get_distance(self, key, gen=0):
        return self.distances[key]
    
    def get_step(self, initial, goal, route):
        return
    
    """
        initial dijsktra from:
        https://gist.github.com/econchick/4666413
    """
    def dijsktra(self, initial, goal=None, start_idx=0):

        visited = {initial: 0}
        path = {}
        nodes = set(self.nodes)

        while nodes:
            min_node = None
            for node in nodes:
                if node in visited:
                    if min_node is None:
                        min_node = node
                    elif visited[node] < visited[min_node]:
                        min_node = node
            if min_node is None:
                break
            nodes.remove(min_node)
            current_weight = visited[min_node]

            gen = self.get_step(min_node, initial, path)

            for edge in self.edges[min_node]:
                distance = self.get_distance((min_node, edge), gen+start_idx)
                weight = current_weight + distance
                if edge not in visited or weight < visited[edge]:
                    
                    visited[edge] = weight
                    path[edge] = min_node
                    
                if goal != None and edge == goal: return visited, path
                        
        return visited, path

    def shortest_path(self, initial_node, goal_node, start_idx=0, paths=None):
        
        if paths == None:
            distances, paths = self.dijsktra(initial_node, goal_node, start_idx)
            
        route = [goal_node]
        while goal_node != initial_node:
            route.append(paths[goal_node])
            goal_node = paths[goal_node]
        route.reverse()
        return route

class Map(Graph):
    
    def __init__(self, floor):
        super(Map, self).__init__()
        self._floor = floor
        self._barrier_map = defaultdict(float)
        self._density_map = defaultdict(lambda : defaultdict(int))
        
    @property
    def barrier_map(self):
        return self._barrier_map
    
    def set_barrier(self, key, val):
        self.barrier_map[key] += val
   
    def get_barrier_map(self):
        return [self.barrier_map[k] for k in self.barrier_map.keys()]
    
    def shift(self, key, num):
        """
            INFO - probably a terrible idea
        """
        pass
    
    @property
    def density_map(self):
        return self._density_map
    
    def get_density(self, key, gen):
        denom = (self.floor.grid_size / 3.28084) **2
        return self.density_map[gen][key] / denom
    
    def get_density_map_at(self, gen):
        return [self.get_density(k, gen) for k in range(len(self.floor.grid))]
    
    def add_density(self, key, gen):
        self.density_map[gen][key] += 1
    
        
    @property
    def floor(self):
        return self._floor
    
    def filter(self, key):
        return self.barrier_map[key]
    
    def get_step(self, initial, goal, route):
        path = [initial]
        while initial != goal:
            path.append(route[initial])
            initial = route[initial]
        curr_gen = len(path)
        return curr_gen
    
    def get_distance(self, key, gen):
        dist = self.distances[key]
        density  = self.get_density(key[1], gen)
        overlays = self.filter(key[1])
        
        return dist + overlays + density

class Bounds2d():
    
    def __init__(self, geo):
        self.geo_pts = rs.CurvePoints(geo)
        self._bds = [self.bds_x(self.geo_pts), self.bds_y(self.geo_pts)]
        self._origin = rc.Geometry.Point3d(self.bds[0][0], self.bds[1][0], 0)
        
        self._dim_x = self._bds[0][1] - self._bds[0][0]
        self._dim_y = self._bds[1][1] - self._bds[1][0]
        
    
    @property
    def pts(self):
        return [ rc.Geometry.Point3d(self.bds[0][0], self.bds[1][0], 0),
            rc.Geometry.Point3d(self.bds[0][1], self.bds[1][0], 0),
            rc.Geometry.Point3d(self.bds[0][1], self.bds[1][1], 0),
            rc.Geometry.Point3d(self.bds[0][0], self.bds[1][1], 0)]
    
    @property
    def bds(self):
        return self._bds
    
    @property
    def origin(self):
        return self._origin
    
    def set_origin(self, pt):
        self._origin = pt
    
    @property
    def plane(self):
        return rc.Geometry.Plane(self.origin, rc.Geometry.Vector3d(0,0,1))
    
    @property
    def x(self):
        return self.bds[0][0]
    
    @property
    def y(self):
        return self.bds[1][0]
    
    def bds_x(self, pts):
        pts.sort(key = lambda pt: pt.X)
        return (pts[0].X, pts[-1].X)
    
    def bds_y(self, pts):
        pts.sort(key = lambda pt: pt.Y)
        return (pts[0].Y, pts[-1].Y)
   
    @property
    def dim_x(self):
        return self._dim_x
    
    @property
    def dim_y(self):
        return self._dim_y
    
    @property
    def centroid(self):
        x_average = self.x + self.dim_x/2
        y_average = self.y + self.dim_y/2
        return rc.Geometry.Point3d(x_average, y_average, 0)
    
    def to_rect(self):
        return rc.Geometry.Rectangle3d(self.plane, self.dim_x, self.dim_y)
    
    def to_grid(self, grid_size):
        
        def mesh_from_rect(rect, grid_size):

            mesh_params = rc.Geometry.MeshingParameters.Default
            mesh_params.MaximumEdgeLength = grid_size
            mesh_params.MinimumEdgeLength = grid_size
            mesh_params.GridAspectRatio = 1

            rect = rc.Geometry.Rectangle3d.ToNurbsCurve(rect)
            return rc.Geometry.Mesh.CreateFromPlanarBoundary(rect, mesh_params)
        
        return mesh_from_rect(self.to_rect(), grid_size)
    
    def contains_pt(self, pt):
        pt = rs.coerce3dpoint(pt)
        if pt.X < self.x or pt.X > (self.x + self.dim_x) or pt.Y < self.y or pt.Y > (self.y + self.dim_y):
            return False
        return True


class Entity(object):
    
    def __init__(self, attr):
        self._pos = defaultdict(lambda: None)
        self._attr = attr
        self._type = 'entity'
    
    def __repr__(self):
        return "Environment Entity: {0} : {1} ".format(self.type, self.get_attribute('name'))

    @property
    def position(self):
        return self._pos[0]
    
    def set_position(self, pos, gen=0):
        self._pos[gen] = pos
    
    def get_position(self, gen=0):
        return self._pos[gen]
    
    @property
    def type(self):
        return self._type
    
    def set_type(self, type):
        self._type = type
    
    @property
    def attributes(self): return self._attr
    
    def set_attribute(self, key, value):
        self._attr[key] = value
    
    def get_attribute(self, key):
        
        def _finditem(obj, key):
            if key in obj: return obj[key]
            for k, v in obj.items():
                if isinstance(v,dict):
                    item = _finditem(v, key)
                    if item is not None:
                        return item
                        
        return _finditem(self.attributes, key)
    
    def has_attribute_value(self, val):
        
        def _findvalue(obj, val):
            if val in obj.values(): return True
            for k,v in obj.items():
                if isinstance(v,dict):
                    value = _findvalue(v, val)
                    if value is not None:
                        return True
            return False
        
        return _findvalue(self.attributes, val)


class Node(Entity):
    
    def __init__(self, pos, attr={}):
        super(Node, self).__init__(attr)
        self.set_position(pos)
        self.set_type('node')

        
class Template(Entity):
    
    def __init__(self, attr={}):
        super(Template, self).__init__(attr)
        self.set_type('template')
    
    @property
    def edges(self):
        return self.get_attribute('edges')

class Floor(Entity):
    
    def __init__(self, geo, attr={}):
        super(Floor, self).__init__(attr)
        self._geo = rs.coercecurve(geo)
        self._bds = Bounds2d(geo)
        self._map = None
        self._msh = None
        self._grid = None
        self._grid_size = None
        self._coords = {}
        
        self.set_position(self.bounds.origin)
        self.set_type('floor')
        
    @property
    def geo(self):
        return self._geo
    
    @property
    def bounds(self):
        return self._bds
    
    @property
    def mesh(self):
        return self._msh
        
    @property
    def map(self):
        return self._map
    
    
    @property
    def grid(self):
        return self._grid
        
    def set_grid(self, grid_size):
        
        indexes = []
        denom = m.sqrt(2*(grid_size**2))
        t_mesh = rs.coercemesh(rs.AddPlanarMesh(self.geo))
        self._msh = self.bounds.to_grid(grid_size)
        self._map = Map(self)
        self._grid_size = grid_size
        
        for i, cpt in enumerate(rs.MeshFaceCenters(self.mesh)):
            line = rc.Geometry.Line(cpt, rc.Geometry.Vector3d(0,0,1))
            if not rc.Geometry.Intersect.Intersection.MeshLine(t_mesh, line)[1]:
                indexes.append(i)

        self.mesh.Faces.DeleteFaces(indexes)
        self._grid = rs.MeshFaceCenters(self.mesh)
        
        for i, pt in enumerate(self.grid):
            self.set_coord(self.to_grid_coord(pt), i)
        
        for i, vertex in enumerate(self.mesh.Vertices):

            edges = self.mesh.TopologyVertices.ConnectedFaces(i)
            for e1 in edges:
                for e2 in edges:
                    if not e1 == e2:
                        weight = rs.Distance(self._grid[e1], self._grid[e2])/denom
                        self.map.add_edge(e1,e2, weight)
                        
        self.add_edge_map()
    
    @property
    def grid_size(self):
        return self._grid_size
    
    @property
    def coords(self):
        return self._coords
    
    def set_coord(self, key, val):
        self._coords[key] = val
    
    def get_index_at_coord(self, key):
        return self._coords[key]
    
    def to_grid_coord(self, pt):
        
        grid_x = self.bounds.dim_x / m.floor(self.bounds.dim_x / self.grid_size)
        grid_y = self.bounds.dim_y / m.floor(self.bounds.dim_y / self.grid_size)
        
        cs_x = m.floor(self.bounds.dim_x / grid_x)
        cs_y = m.floor(self.bounds.dim_y / grid_y)

        pt_x = m.floor((pt.X - self.position.X)/ grid_x)
        pt_y = m.floor((pt.Y - self.position.Y)/ grid_y)
        
        return (pt_x, pt_y)
    
    def to_grid_index(self, pt):
        
        coord = self.to_grid_coord(pt)
        return self.get_index_at_coord(coord)
    
    
    def add_edge_map(self):
        
        def _func(num):
            if num == 8: return 0
            else: return 0.5
            
        for i, pt in enumerate(self.grid):
            edges = self.map.edges[i]
            self.map.set_barrier(i, _func(len(edges)))
    
    def add_barrier_map(self, barrier):
        for i, pt in enumerate(self.grid):
            if barrier.bounds.contains_pt(pt):
                if rs.PointInPlanarClosedCurve(pt, barrier.geo):
                    self.map.set_barrier(i, float('inf'))
                    for e in self.map.edges[i]:
                        self.map.set_barrier(e, 0.5)

        
class Barrier(Entity):
    
    def __init__(self, geo, attr={}):
        super(Barrier, self).__init__(attr)
        self._geo = rs.coercecurve(geo)
        self._bds = Bounds2d(geo)
        
        self.set_position(self.bounds.origin)
        self.set_type('barrier')
        
    @property
    def geo(self):
        return self._geo
    
    @property
    def bounds(self):
        return self._bds
        

class Agent(Entity):
    
    def __init__(self, pos=None, attr={}, env=None):
        super(Agent, self).__init__(attr)
        self._attr = attr
        self._env = env
        self._state = None
        self._history = []
        self._path = []
        
        self.set_position(pos)
        self.set_type('agent')
        
        self.age = 0
        self.__hold = None
        self.is_active = True
        self.is_complete = False
                
    
    @property
    def position(self):
        return self.get_position(self.age)
        
    def shift(self, num):
        print 'shift'
        index = self.state[-2]
        
        left = len(self.state)
        print left, 'steps to goal'
        self._path[-1].insert(left, index)
        self.history.append(self.position)
        #print self.age, self._pos
        
        
        """
        self.environment.floors[0].map.add_density(path[pi], self.age+pi)
        self.set_position(path[pi], self.age+pi)
        """
        
        """
            TODO - not clean at all - MAke this better
        """
        keys = self._pos.keys()
        keys.sort()
        keys = keys[self.age:]
        keys.reverse()
        _dict = copy.copy(self._pos)
        #print _dict
        for ki in range(len(keys)):
            _dict[keys[ki]+1] = _dict[keys[ki]]
            #self._pos[keys[ki]] = self._pos[keys[ki+1]]
        #print _dict
        self._pos = _dict
        
        
    @property
    def grid_index(self):
        return self.environment.floors[0].to_grid_index(self.position.position)
    
    @property
    def state(self):
        return self._state
    
    def set_state(self, state):
        self._state = state
    
    @property
    def destination(self):
        val = self.get_attribute('destination')
        return random.choice(self.environment.get_nodes_with_value(val))
    
    
    
    @property
    def path(self):
        print 'making path', self._path
        _path = sum([p for p in self._path], [])
        _dict = {idx: self.environment.floors[0].grid[idx] for idx in set(_path)}
        return [_dict[p] for p in _path]
    
    def add_path(self, path):
        self._path.append(copy.deepcopy(path))
        print 'added path', self._path
    
    
    @property
    def history(self):
        return self._history
    
    @property
    def visited(self):
        """
            TODO - this needs to become more standard - maybe a property of the node?
        """
        return [n.get_attribute('name') for n in self.history if not type(n) == int]
    
    
    @property
    def environment(self):
        return self._env
    
    def set_environment(self, env):
        self._env = env
        
    def toggle_active(self):
        self.is_active = not self.is_active
        
    def toggle_complete(self):
        self.is_complete = not self.is_complete
    
    def step(self):        
        
       
        def wait(time):
            return self.position, [self.position] * time
    
    
        def move(lst):
            
            lst = [l for l in lst if not l.get_attribute('name') in self.visited]
            
            if len(lst):
            
                properties = self.get_attribute('properties')
                keys = properties.keys()
                n_percs = [k for k in keys if random.randint(0,100) <= properties[k]]
                
                lst = [(l, self.environment.graph.get_distance((self.position, l))) for l in lst if l.get_attribute('name') in n_percs]
            
                if len(lst):
                    
                    lst.sort(key = lambda tup: len(tup[1]))
                    lst.reverse()
                    ncount=0
                    while len(lst) and ncount < 100 :
                        
                        ncount+=1
                        if ncount ==100: print ">>>>>>>>>>>>>>>>>> broke inner while loop"
                        tup = lst.pop()
                        n_choice = tup[0]
                        
                        """
                            TODO - switch agents_at_position to consider generation
                                 this currently looks at the amount of people with the same destination
                        """
                        #num_people = len(self.environment.agents_at_position(n_choice, self.age))
                        num_people = len([a for a in self.environment.agents if self.__hold == a.__hold and a != self])
                        capacity = n_choice.get_attribute('capacity')

                        if capacity != None:
                            if num_people < float(capacity):
                                break
                            else:
                                if random.randint(0,100) < self.get_attribute('queuing'):
                                    break
                                else: 
                                    continue
                        else:
                            break
                else:
                    n_choice = self.destination
            else:
                n_choice = self.destination
                self.toggle_complete()
            
            """
                TODO - replace with entity.to_grid_index(environment)
            """
            n_index = self.environment.floors[0].to_grid_index(n_choice.position)
            n_path = self.environment.floors[0].map.shortest_path(self.grid_index, n_index, start_idx=self.age)
            
            return n_choice, n_path


        if not len(self.history):

            start_node = self.get_attribute('origin')
            start_positions = self.environment.get_nodes_with_value(start_node)
            start_position = random.choice(start_positions)
            
            self.set_position(start_position)
            self.set_state('waiting')
            
        else:

            if self.is_active:
                
                print 'position: ', self.position, 'currently', len(self.environment.agents_at_position(self.position, self.age)), 'ppl'
                print 'state: ', self.state
                
                
                if self.state == 'ready':
                    
                    self.__hold, path = move(self.environment.graph.edges[self.position])
                    #self.add_path([self.environment.floors[0].grid[i] for i in path])
                    self.add_path(path)
                    
                    for pi in range(len(path)):
                        self.environment.floors[0].map.add_density(path[pi], self.age+pi)
                        self.set_position(path[pi], self.age+pi)
                    
                    path.reverse()
                    self.set_state(path)
               
               
                if self.state == 'waiting':
                    
                    num_people = len(self.environment.agents_at_position(self.__hold, self.age))+1
                    """
                        Wait time set to random for now
                    """
                    wait_time = random.randint(1,3) * num_people
                    
                    self.__hold, path = wait(wait_time)
                    self.add_path([self.grid_index] * wait_time)
                    
                    for pi in range(len(path)):
                        self.environment.floors[0].map.add_density(self.grid_index, self.age+pi)
                        self.set_position(path[pi], self.age+pi)
                    
                    path.reverse()
                    self.set_state(path)
               
               
                elif len(self.state) == 1:
                    
                    self.set_position(self.__hold, self.age)
                    
                    if self.is_complete:
                        self.set_state('complete')
                        self.toggle_active()
                    else:
                        if self.position == self.state[0]:
                            self.set_state('ready')
                        else:
                            self.set_state('waiting')
                            
                            
                else:
                    
                                        
                    """
                        TEMP
                   """
                    index = self.state[-2]
                    num_people = len(self.environment.agents_at_position(index, self.age))
                    print 'next step: ',index
                    print self._path
                    print num_people, 'ppl currently at next step'
                    if num_people >0 and type(index) != Node :
                        print ' ##################################################################### wait'
                        self.state.append(self.position)
                        self.shift(1)
                        
                    """
                        END TEMP
                    """
                    
                    self.age+=1
                    self.state.pop()

        self.history.append(self.position)
        
        
        
class Environment():
    
    def __init__(self, resolution=30):
        self._entities = defaultdict(list)
        self._agents = []
        self._graph = copy.deepcopy(Graph()) # bad - fix later
        self._graph_paths = {}
        self._resolution = resolution
    
    def __repr__(self):
        return 'Environment: {0} agents, {1} nodes, {2} floors'.format(len(self.agents), len(self.graph.nodes), len(self.floors))
    
    @property
    def resolution(self):
        return self._resolution
    
    
    @property
    def entities(self):
        return self._entities
     
    def add_entity(self, entity):
        self.entities[entity.type].append(entity)
    
    def add_entities(self, entities):
        
        def _add_floor(entity):
            entity = Floor(entity['geometry'], entity['profile'])
            self.add_floor(entity)
            self.add_entity(entity)
        
        def _add_node(entity):
            entity = Node(entity['position'], entity['profile'])
            self.add_node(entity)
            self.add_entity(entity)
            
        def _add_template(entity):
            entity = Template(entity['profile'])
            self.add_template(entity)
            self.add_entity(entity)
        
        def _add_barrier(entity):
            entity = Barrier(entity['geometry'], entity['profile'])
            self.add_barrier(entity)
            self.add_entity(entity)
        
        def _add_agent(entity):
            entity = Agent(attr=entity['profile'])
            self.add_agent(entity)
            self.add_entity(entity)
        
        
        dict = defaultdict(list)
        for entity in entities:
            dict[entity['type']].append(entity)
        
        if len(dict['floor']):
            for  floor in dict['floor']:
                _add_floor(floor)
        else:
            """
                TODO - return a warning
            """
            print 'environment needs at least one floor to run'
            
        if len(dict['node']):
            ghpythonlib.parallel.run(_add_node, dict['node'], False)
            #for node in dict['node']:
            #    _add_node(node)
        else:
            """
                TODO - return a warning
            """
            print 'environment needs at least two nodes to run'
        
        if len(dict['template']):
            for template in dict['template']:
                _add_template(template)
        else: self.add_default_template()

        if len(dict['barrier']):
            for barrier in dict['barrier']:
                _add_barrier(barrier)
            
        if len(dict['agent']):
            for agent in dict['agent']:
                _add_agent(agent)
        else:
            """
                TODO - return a warning
            """
            print 'environment needs at least one agent to run'


    @property
    def graph(self):
        return self._graph
    
    @property
    def graph_paths(self):
        return self._graph_paths
    
    def get_graph_path(self, n1, n2):
        
        floor = self.floors[0] # bad - fix later
        idx1 = floor.to_grid_index(n1.position)
        idx2 = floor.to_grid_index(n2.position)
        return floor.map.shortest_path(idx1, idx2, paths=self.graph_paths[n1])
    
    def set_graph_path(self, key, val):
        self._graph_paths[key] = val
    
    
    @property
    def templates(self):
        return [n for n in self.entities['template']]
    
    def add_template(self, template):
        if template.get_attribute('directed') == False:
            for edge in template.edges:
                nodes = [n for n in self.nodes if n.position in edge]
                if len(nodes) == 2:
                    path = self.get_graph_path(nodes[0], nodes[1])
                    self.graph.add_edge(nodes[0], nodes[1], path)
    
    def add_default_template(self):
        for n1 in self.graph.nodes:
            for n2 in self.graph.nodes:
                if not n1 == n2: 
                    path = self.get_graph_path(n1, n2)
                    self.graph.add_edge(n1, n2, path)
    
    
    @property
    def agents(self):
        return self._agents
        
    def add_agent(self, agent, other=None):
        agent.set_environment(self)
        self.agents.append(agent)
    
    def agents_at_position(self, position, gen=0):
        return [a for a in self.agents if a.get_position(gen) == position]
        #return [a for a in self.agents if a.position == position]
    
    
    @property
    def nodes(self):
        return [n for n in self.entities['node']]
    
    def add_node(self, node):
        self.graph.add_node(node)
        """
            TODO - floors need to be referenced better
        """
        djk = self.floors[0].map.dijsktra(self.floors[0].to_grid_index(node.position))
        self.set_graph_path(node, djk[1])
    
    def get_nodes_with_value(self, val):
        return [n for n in self.nodes if n.has_attribute_value(val)]
    
    
    @property
    def floors(self):
        return [n for n in self.entities['floor']]
    
    def add_floor(self, floor):
        floor.set_grid(self.resolution)
    
    def set_grid(self, grid_size):
        
        """
            TODO - implement more complexity
            grids will need to match up between floors
               - maybe 1 unified graph to hold graphs?
        """
        for floor in self.floors: floor.set_grid(grid_size)
    
    
    @property
    def paths(self):
        return [a.path for a in self.agents]
    
    def add_barrier(self, barrier):
        
        """
            TODO - implement multiple floors: barriers should be declared with
            their floor identifier.
            single floor use only for now
        """
        for floor in self.floors:
            floor.add_barrier_map(barrier)
    
    
    def generation(self, gen):
        return [a.get_position(gen) for a in self.agents]

    def step(self):
        
        def _func(agent):
            if agent.is_active:
                agent.step()
        
        print '______________________________________________________'
        print 'NEW STEP'
        #ghpythonlib.parallel.run(_func, self.agents, False)
        for i, agent in enumerate(self.agents):
            print 'agent', i
            _func(agent)
    
    def run(self):
        count = 0
        while len([a for a in self.agents if a.is_active]) and count < 500:
            self.step()
            count+=1
            if count ==500: print ">>>>>>>>>>>>>>>>>>>>>>>>> broke outer while loop"
        

if len(entities) != 0 and res != None:
    environment = Environment(resolution=res)
    environment.add_entities(entities)
    
    a = environment
# ---------- end env_3 ----------

# ----
dam_2 = DataDam(DataA=env_2.a, BufferDelay=10000000, BufferMode=0)
run = PythonScript(env=dam_2, run=Toggle(True))  # -> out, paths, activity_map, density_map, barrier_map, mesh
# ---------- run: Python ----------
import clr
clr.AddReference("Grasshopper")
from Grasshopper import DataTree
from Grasshopper.Kernel.Data import GH_Path
from itertools import chain
import copy

path_tree = DataTree[object]()
density_tree = DataTree[object]()

mesh = env.floors[0].mesh

if env != None and run:
    
    env = copy.deepcopy(env)
    env.run()
    
    for i, path in enumerate(env.paths):
        gh_path = GH_Path(i)
        for p in path: path_tree.Add(p, gh_path)
    
    
    activity = [0] * len(env.floors[0].grid)

    for gen in env.floors[0].map.density_map.keys():
        map = env.floors[0].map.get_density_map_at(gen)
        gh_path = GH_Path(gen)
        for i, m in enumerate(map):
            activity[i] += m
            density_tree.Add(m, gh_path)
    
    
    barrier_map = env.floors[0].map.get_barrier_map()
    activity_map = activity
    density_map = density_tree
    paths = path_tree
# ---------- end run ----------
panel = Panel(run.out)
run_2 = PythonScript(env=dam_2, run=Toggle(False))  # -> out, paths, activity_map, density_map, barrier_map, mesh; same code as run

Z = UnitZ(Factor=-1)
gradient = Gradient(LowerLimit="1", UpperLimit="0", Parameter=run_2.barrier_map, stops=[0: RGB(255, 255, 255), 1: RGB(0, 0, 0)])
move = Move(Geometry=run_2.mesh, Motion=Z)  # -> Geometry, Transform
explode = MeshExplode(Mesh=move.Geometry, Interpolate=False)
preview = CustomPreview(Geometry=explode, Shader=gradient)

facen = FaceNormals(Mesh=move.Geometry)  # -> Centers, Normals
lng = ListLength(List=facen.Centers)
series = Series(Start=0, Step=1, Count=lng)
int = Integer(series)
tag = TextTag3D(Location=facen.Centers, Text=int, Size=Slider(1, range=0..1), Justification=7)

number_slider_2 = Slider(0, range=0..10)

Z_2 = UnitZ(Factor=-1)
move_2 = Move(Geometry=run.mesh, Motion=Z_2)  # -> Geometry, Transform
explode_2 = MeshExplode(Mesh=move_2.Geometry, Interpolate=False)
branch = TreeBranch(Tree=run.density_map, Path=Slider(0, range=0..100), MaintainPaths=True)
bnd = Bounds(Numbers=branch)
remap = RemapNumbers(Value=branch, Source=bnd, Target=Domain(0, 1))  # -> Mapped, Clipped
gradient_2 = Gradient(
    LowerLimit="1",
    UpperLimit="0",
    Parameter=remap.Mapped,
    stops=[0: RGB(234, 38, 0), 0.25: RGB(234, 126, 0), 0.5: RGB(254, 244, 84), 0.75: RGB(173, 203, 249), 1: RGB(75, 107, 169)])
preview_2 = CustomPreview(Geometry=explode_2, Shader=gradient_2)

Z_3 = UnitZ(Factor=-1)
equals = Equality(FirstNumber=run.activity_map, SecondNumber="0")  # -> Equality, Inequality
move_3 = Move(Geometry=run.mesh, Motion=Z_3)  # -> Geometry, Transform
Z_4 = UnitZ(Factor=-2)
cullf = CullFaces(Mesh=move_3.Geometry, Pattern=equals.Equality)
cull = CullPattern(List=run.activity_map, CullPattern=equals.Inequality)
move_4 = Move(Geometry=run.mesh, Motion=Z_4)  # -> Geometry, Transform
explode_3 = MeshExplode(Mesh=cullf, Interpolate=False)
sort = SortList(Keys=cull)  # -> Keys, ValuesA
cull_i = CullIndex(List=reverse(sort.Keys), Indices=[0, 1, 2, 3, 4, 5], Wrap=True)
bnd_2 = Bounds(Numbers=cull_i)
remap_2 = RemapNumbers(Value=cull, Source=bnd_2, Target=Domain(0, 1))  # -> Mapped, Clipped
preview_3 = CustomPreview(Geometry=move_4.Geometry, Shader=ColourSwatch(SwatchColor=RGB(61, 86, 138)))
gradient_3 = Gradient(
    LowerLimit="1",
    UpperLimit="0",
    Parameter=remap_2.Mapped,
    stops=[0: RGB(234, 38, 0), 0.25: RGB(234, 126, 0), 0.5: RGB(254, 244, 84), 0.75: RGB(173, 203, 249), 1: RGB(75, 107, 169)])
preview_4 = CustomPreview(Geometry=explode_3, Shader=gradient_3)

Z_5 = UnitZ(Factor=-1)
gradient_4 = Gradient(LowerLimit="1", UpperLimit="0", Parameter=run.barrier_map, stops=[0: RGB(255, 255, 255), 1: RGB(0, 0, 0)])
move_5 = Move(Geometry=run.mesh, Motion=Z_5)  # -> Geometry, Transform
explode_4 = MeshExplode(Mesh=move_5.Geometry, Interpolate=False)
preview_5 = CustomPreview(Geometry=explode_4, Shader=gradient_4)

nurbs = NurbsCurve(Vertices=run.paths, Degree=Slider(1, range=1..5), Periodic=False)  # -> Curve, Length, Domain
previewlw = CustomPreviewLineweights(Geometry=nurbs.Curve, Shader=ColourSwatch(SwatchColor=RGB(255, 255, 255)), Thickness=Slider(2, range=0..10))

facen_2 = FaceNormals(Mesh=move_5.Geometry)  # -> Centers, Normals
lng_2 = ListLength(List=facen_2.Centers)
series_2 = Series(Start=0, Step=1, Count=lng_2)
int_2 = Integer(series_2)
tag_2 = TextTag3D(Location=facen_2.Centers, Text=int_2, Size=Slider(1, range=0..1), Justification=7)

item = ListItem(List=run.paths, Index=Slider(0, range=0..1000), Wrap=Toggle(False))
