# Grasshopper definition test.gh (Grasshopper 0.9.76)
# plug-ins: MeshEdit Components, Circulation

geo = Geometry(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)
geo_2 = Geometry(<curve referenced from the Rhino model>)
settings = NodeSettings(Geometry=geo_2)
pt = Point(Point(14.48587065, 16.53675253, 0))
settings_2 = NodeSettings(Geometry=geo)
pt_2 = Point(Point(1.065486422, 15.52326095, 0))

pt_3 = Point(Point(10.41676039, 2.532634864, 0))
pt_4 = Point(Point(9.469479853, 23.40991662, 0))
node = Node(Position=pt_3, Name="end", Floor="floor")
node_2 = Node(Position=pt_4, Name="start", Floor="floor")

geo_3 = Geometry(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)
geo_4 = Geometry(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)
floor = Floor(Boundary=geo_4, Name="floor")
node_3 = Node(Position=pt_2, Name="dwell2", Floor="floor", Settings=settings)
barrier = Barrier(Boundary=geo_3, Floor="floor")
node_4 = Node(Position=pt, Name="dwell1", Floor="floor", Settings=settings_2)
settings_3 = AgentSettings(PathNodes=["dwell2", "dwell1"], NodePropensities=Slider(0.5, range=0..1), Count=Slider(100, range=0..100))
agent = Agent(Name="agent", Origin="start", Destination="end", Settings=settings_3)
env = Environment(Entities=[floor, barrier, node_2, node, node_4, node_3, agent], Resolution=Slider(1, range=0..1), Run=Toggle(True))
number_slider = Slider(0, range=0..100)

toggle = BooleanToggle(True)
dmap = DensityMap(Environment=env, FloorName="floor", Generation=number_slider, NonZero=toggle)  # -> Mesh, Values
gradient = Gradient(
    LowerLimit=1,
    UpperLimit=0,
    Parameter=dmap.Values,
    stops=[0: RGB(234, 38, 0), 0.25: RGB(234, 126, 0), 0.5: RGB(254, 244, 84), 0.75: RGB(173, 203, 249), 1: RGB(75, 107, 169)])
explode = MeshExplode(Mesh=dmap.Mesh, Interpolate=False)
preview = CustomPreview(Geometry=explode, Shader=gradient)

bmap = BarrierMap(Environment=env, FloorName="floor")  # -> Mesh, Values
gradient_2 = Gradient(LowerLimit=0, UpperLimit=1, Parameter=bmap.Values, stops=[0: RGB(0, 128, 0), 0.5: RGB(255, 255, 0), 1: RGB(255, 0, 0)])
explode_2 = MeshExplode(Mesh=bmap.Mesh, Interpolate=False)
preview_2 = CustomPreview(Geometry=explode_2, Shader=gradient_2)

nmap = NodeMap(Environment=env, NodeName=["dwell1", "dwell2"], Generation=number_slider, NonZero=toggle)  # -> Mesh, Values
gradient_3 = Gradient(
    LowerLimit=1,
    UpperLimit=0,
    Parameter=nmap.Values,
    stops=[0: RGB(234, 38, 0), 0.25: RGB(234, 126, 0), 0.5: RGB(254, 244, 84), 0.75: RGB(173, 203, 249), 1: RGB(75, 107, 169)])
explode_3 = MeshExplode(Mesh=nmap.Mesh, Interpolate=False)
preview_3 = CustomPreview(Geometry=explode_3, Shader=gradient_3)
