# Grasshopper definition skeleton.ghx (Grasshopper 0.9.76)
# plug-ins: Python Interpreter

geo = Geometry(<curve referenced from the Rhino model>)
cp = ControlPoints(Curve=geo)  # -> Points, Weights, Knots
cull_i = CullIndex(List=cp.Points, Indices="-1", Wrap=True)
python = PythonScript(pts=cull_i)  # -> out, a; inputs pts: list
# ---------- python: Python ----------
import rhinoscriptsyntax as rs

class Skeleton():
    
    def __init__(self, pts):
        
        self._pts = pts
        self._vecs = [rs.VectorUnitize(rs.VectorCreate(pts[i+1], pts[i])) for i in range(len(pts)-1)]
        self._bisectors = []
        
        self.set_bisectors()
        
    @property
    def pts(self):
        return self._pts
    
    @property
    def vecs(self):
        return self._vecs
    
    @property
    def bisectors(self):
        return self._bisectors
        
    def set_bisectors(self):
        
        self._bisectors = []
        
        for vi in range(len(self.vecs)):
            cross_vec = rs.VectorCrossProduct(self.vecs[vi], self.vecs[vi-1])
            
            if cross_vec.Z > 0:
                self.bisectors.append(rs.VectorAdd(self.vecs[vi],
                    rs.VectorReverse(self.vecs[vi-1])))
            
            elif cross_vec.Z < 0:
                self.bisectors.append(rs.VectorAdd(self.vecs[vi-1],
                    rs.VectorReverse(self.vecs[vi])))
                


skel = Skeleton(rs.coerce3dpointlist(pts))
a = skel.bisectors
# ---------- end python ----------
vdis = VectorDisplay(Anchor=cull_i, Vector=python.a)
panel = Panel(python.a)
